# Grasshopper definition run_tests_in_ironpython.gh (Grasshopper 1.0.7)

python = GhPythonScript()  # -> out, a
# ---------- python: Python ----------
from honeybee.room import Room
from honeybee.model import Model
from honeybee_openstudio.openstudio import openstudio_model, OSModel
from honeybee_openstudio.writer import model_to_openstudio, face_to_openstudio


room = Room.from_box('Tiny_House_Zone', 5, 10, 3)
model = Model('Tiny_House', [room])
os_model = model_to_openstudio(model)

spaces = os_model.getSpaces()
for space in spaces:
    for face in space.surfaces:
        print(face)
# ---------- end python ----------
python_2 = GhPythonScript(test_dir="C:\Users\Chris\Documents\GitHub\honeybee-openstudio\tests", run=Toggle(False))  # -> out
# ---------- python_2: Python ----------
import os
import sys
import importlib
import inspect
from ladybug_rhino.grasshopper import all_required_inputs


def run_test_functions(module_name):
    for name, obj in inspect.getmembers(module_name):
        if inspect.isfunction(obj):
            if obj.__name__.startswith('test'):
                obj()
                print('Passed: {}'.format(obj.__name__))

EXCLUDE = ['__init__.py', 'cli_test.py']


if all_required_inputs(ghenv.Component) and _run:
    if _test_dir not in sys.path:
        sys.path.append(_test_dir)
    
    for test_mod in os.listdir(_test_dir):
        if os.path.isfile(os.path.join(_test_dir, test_mod)):
            if not test_mod in EXCLUDE:
                print(test_mod)
                test_mod = importlib.import_module(test_mod.replace('.py', ''))
                run_test_functions(test_mod)
# ---------- end python_2 ----------
panel = Panel(python_2)
